# Grasshopper definition GSDlogo_milling_tracy.gh (Grasshopper 1.0.7)
# plug-ins: Human

pt = Point(<point referenced from the Rhino model>)
pt_2 = Point(<point referenced from the Rhino model>)
c_script = CSharpScript(
    rx=Slider(18, range=0..30),
    ry=Slider(13, range=0..50),
    p1=pt,
    p2=pt_2,
    mod=Slider(6, range=1..10),
    spid=Slider(35, range=1..200))  # -> out, pts, polyline, text, length, timecost; inputs rx: Int32, ry: Int32, p1: Point3d, p2: Point3d, mod: Int32, spid: Int32
# ---------- c_script: C# usings ----------
using System.IO;
using System.Linq;
using System.Data;
using System.Drawing;
using System.Reflection;
using System.Windows.Forms;
using System.Xml;
using System.Xml.Linq;
using System.Runtime.InteropServices;

using Rhino.DocObjects;
using Rhino.Collections;
using GH_IO;
using GH_IO.Serialization;
# ---------- c_script: C# ----------
    Grid2pts(p1, p2, rx, ry);

    int k = 0;
    int i, j;
    double d1 = (ry - 1) / 6;
    double d2 = (rx - 1) / 4;
    double ny = Math.Floor(d1);
    double nx = Math.Floor(d2);


    StartMill();

    for(j = 0; j < ry ; j++){
      for(i = 0; i < rx  ; i++){
        k = j * rx + i;
        if( j < ny * 6 + 1 && i < 4 * nx){

          if( j % 12 < 7){
            if(i % 4 == 2 && j % 6 == 2){

              // draw a parallelogram

              addPath(k);
              addPath(k + 4 * rx);
              addPath(k + 3 * rx + 2);
              addPath(k - rx + 2);
              addPath(k);

              // draw a second parallelogram

              addPath(k - 2 * rx);
              addPath(k - rx - 2);
              addPath(k + 3 * rx - 2);
              addPath(k + 2 * rx);

              // draw triangle
              addPath(k + rx - 2);
              addPath(k);
              addPath(k + rx + 2);
              addPath(k + 2 * rx);
            }}

          if(j % 12 > 6){
            if(i % 4 == 2 && j % 6 == 2){
              
              int interval = (int)Math.Round(rx - 4 * nx-1);
              int m = k + rx - 1 - 2 * i- interval;

              // change starting point , draw a parallelogram

              addPath(m);
              addPath(m + 4 * rx);
              addPath(m + 3 * rx + 2);
              addPath(m - rx + 2);
              addPath(m);

              // draw a second parallelogram

              addPath(m - 2 * rx);
              addPath(m - rx - 2);
              addPath(m + 3 * rx - 2);
              addPath(m + 2 * rx);

              // draw triangle
              addPath(m + rx - 2);
              addPath(m);
              addPath(m + rx + 2);
              addPath(m + 2 * rx);
            }}
        }
      }
    }


    endMill();
    CalcTime();

    _pts = pts;
    _polyline = poly;
    _text = text;
    _length = poly.Length;
    _timecost = time;
# ---------- c_script: C# additional code ----------
  List<Point3d> pts = new List<Point3d>();
  Polyline poly = new Polyline();
  List<string> text = new List<string>();
  double time = 0.0;

  void StartMill(){
    text.Add("start milling");
    return;
  }

  void addPath(int index){
    if(index < 0 || index >= (pts.Count)) return;
    poly.Add(pts[index]);
    text.Add("X " + pts[index].X + " Y " + pts[index].Y + " Z " + pts[index].Z);
    return;
  }

  void addPath2(int index, double scale){
    if(index < 0 || index >= (pts.Count)) return;
    Point3d p = new Point3d(pts[index].X, pts[index].Y, poly.Count * scale);
    poly.Add(p);
    text.Add("X " + p.X + " Y " + p.Y + " Z " + p.Z);
    return;
  }

  void endMill(){
    text.Add("end milling");
    return;
  }

  void CalcTime(){
    poly.MergeColinearSegments(0.01, false);
    time = poly.Length + poly.Count * 3;
  }

  // this is a function that draws grid of points from two min, max points
  void Grid2pts(Point3d p1, Point3d p2, int rx, int ry){
    pts.Clear();
    poly.Clear();

    text.Clear();
    time = 0.0;

    double dy = (p2.Y - p1.Y) / (ry - 1.0);
    double dx = (p2.X - p1.X) / (rx - 1.0);
    int i, j;
    for(j = 0; j < ry; j++){
      for(i = 0; i < rx; i++){
        Point3d pt = new Point3d(p1.X + i * dx, p1.Y + j * dy, p1.Z);
        pts.Add(pt);
      }
    }
    return;
  }
# ---------- end c_script ----------
curve = Curve(c_script.polyline)
panel = Panel(c_script.text)
panel_2 = Panel(c_script.length)
panel_3 = Panel(c_script.timecost)

number_slider = Slider(1, range=0..10)
pt_3 = Point(c_script.pts)
previewlw = CustomPreviewLineweights(Geometry=curve, Shader="black", Thickness=Slider(3, range=0..10), Absolute=False)
dots = DotDisplay(Point=pt_3, Colour="gray", Size=Slider(0.1, range=0..0.1))
