# Grasshopper definition Spatial Truss Generator_Tracy.gh (Grasshopper 1.0.7)

srf = Surface(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)
c_script = CSharpScript(srf=srf, uCount=Slider(10, range=0..10), vCount=Slider(9, range=0..10), dist=Slider(8.7, range=0..10))  # -> out, A, B; inputs srf: Surface, uCount: Int32, vCount: Int32, dist: Double
# ---------- c_script: C# ----------
        srf.SetDomain(0, new Interval(0.0, 1.0));
    srf.SetDomain(1, new Interval(0.0, 1.0));
    double du = 1.0 / (double) (uCount - 1.0);
    double dv = 1.0 / (double) (vCount - 1.0);

    List<Curve> crvs = new List<Curve> ();
    List<Point3d> offsetpts = new List<Point3d> ();
    List<Line> lines = new List<Line> ();


    int i,j;
    for ( i = 0; i < uCount;i++){
      for ( j = 0; j < vCount;j++){

        crvs.Add(srf.IsoCurve(0, dv * j));
        crvs.Add(srf.IsoCurve(1, du * i));
        Vector3d n = srf.NormalAt(du * i, dv * j);
        if(i !=uCount-1){
          Point3d midpt = srf.PointAt((du * i + du * (i + 1)) / 2, dv * j) + n * dist;
          offsetpts.Add(midpt);}
       
      }}
    Surface offsetSrf = NurbsSurface.CreateThroughPoints(offsetpts, uCount-1, vCount, 3, 3, false, false);
    offsetSrf.SetDomain(0, new Interval(0.0, 1.0));
    offsetSrf.SetDomain(1, new Interval(0.0, 1.0));
    double u1;
    double u2;
    double v1;
    double v2;
    for ( i = 0; i < uCount;i++){
      for ( j = 0; j < vCount;j++){
        Vector3d n = srf.NormalAt(du * i, dv * j);
        Point3d offsetpt = srf.PointAt(du * i, dv * j) + n * dist;

        offsetSrf.ClosestPoint(offsetpt, out u1, out v1);
        Curve offsetcrv_V = offsetSrf.IsoCurve(0, v1);
        crvs.Add(offsetcrv_V);
        if(i != uCount - 1){
          Point3d pt1 = srf.PointAt(du * i, dv * j);
          Point3d pt2 = srf.PointAt(du * (i + 1), dv * j);
          Point3d midpt1 = srf.PointAt((du * i + du * (i + 1)) / 2,dv*j);
          Point3d midpt2 = midpt1 + n * dist;
          offsetSrf.ClosestPoint(midpt2, out u2, out v2);
          Point3d midpt3 = offsetSrf.PointAt(u2, v2);
          crvs.Add(offsetSrf.IsoCurve(1,u2));
          lines.Add(new Line(pt1, midpt3));
          lines.Add(new Line(pt2, midpt3));

        }








      }}

    A = crvs;
    B = lines;
# ---------- end c_script ----------
