# Grasshopper definition weaving pattern.gh (Grasshopper 1.0.7)

# Radius
number_slider = Slider(0.4, range=0..10)
# Input Surface
# U Direction Division
srf = Surface(<surface referenced from the Rhino model>)
# V Direction Division
number_slider_2 = Slider(25, range=0..100)
# Depth of the Weaving
number_slider_3 = Slider(0.5, range=0..10)
weave_pattern = CSharpScript(
    S=srf,
    u=number_slider_2,
    v=Slider(20, range=0..100),
    depth=number_slider_3,
    r=number_slider,
    TooltipDescriptionOverride="Create Weave Pattern",
    TooltipTextOverride="Weave Pattern")  # -> out, Pipes; inputs S: Surface, u: Int32, v: Int32, depth: Double, r: Double
# ---------- weave_pattern: C# ----------
    // domain of surface
    Interval uDomain = S.Domain(0);
    Interval vDomain = S.Domain(1);
    double du = uDomain.Length / u;
    double dv = vDomain.Length / v;

    // divide the surface by uv
    DataTree<Point3d> pts_u = new DataTree<Point3d>();
    DataTree<Point3d> pts_v = new DataTree<Point3d>();
    DataTree<Vector3d> normals = new DataTree<Vector3d>();

    for (int i = 0;i < u + 1;i++)
    {
      double U = uDomain.T0 + i * du;
      GH_Path path = new GH_Path(i);

      for(int j = 0;j < v + 1;j++)
      {
        double V = vDomain.T0 + j * dv;

        // get the info from UVPoint in S
        Point3d uvPoint = S.PointAt(U, V);
        Vector3d uvNormal = S.NormalAt(U, V);
        pts_u.Add(uvPoint, path);
        pts_v.Add(uvPoint, path);
        normals.Add(uvNormal, path);
      }
    }

    // define point moving direction,normal or inversed normal
    double direction_u = 1;
    double direction_v = 1;
    for(int i = 0;i < pts_u.BranchCount; i++)
    {
      List<Point3d> branch = pts_u.Branches[i];
      GH_Path path_New = new GH_Path(i);
      for (int j = 0; j < branch.Count;j++)
      {
        // different direction at odd rows and even rows.
        // within each row, odds column and even columns are different too
        if((i % 2 == 0 && j % 2 == 0) || (i % 2 == 1 && j % 2 == 1))
        {
          direction_u = 1;
          direction_v = -1;
        }
        else
        {
          direction_u = -1;
          direction_v = 1;
        }
        // moving point by its due direction

        pts_u.Branch(i)[j] = pts_u.Branch(i)[j] + normals.Branch(i)[j] * depth * direction_u;
        pts_v.Branch(i)[j] = pts_v.Branch(i)[j] + normals.Branch(i)[j] * depth * direction_v;
      }
    }

    List<Curve> Crvs_U = new List<Curve>();
    List<Curve> Crvs_V = new List<Curve>();
    int branchNum = pts_u.Branch(0).Count;
    for (int i = 0;i < pts_u.BranchCount;i++)
    {
      // connecting points in u direction

      List < Point3d > Crv_U_pt = pts_u.Branch(i);
      Curve Crv_U = Curve.CreateInterpolatedCurve(Crv_U_pt, 3);
      Crvs_U.Add(Crv_U);
    }
    // connecting points in v direction(transpose the tree)
    for (int j = 0;j < branchNum ;j++)
    {
      List<Point3d> Crv_V_pt = new List<Point3d>();
      for(int i = 0;i < pts_v.BranchCount;i++)
      {
        Crv_V_pt.Add(pts_v.Branch(i)[j]);
        //

      }
      Curve Crv_V = Curve.CreateInterpolatedCurve(Crv_V_pt, 3);
      Crvs_V.Add(Crv_V);
    }

    //Combine 2 list and make pipe

    List<Mesh> pipe = new List<Mesh> ();

    for(int i = 0;i < Crvs_U.Count;i++)
    {
      var pipe_ui = Mesh.CreateFromCurvePipe(Crvs_U[i], r, 100, 50, MeshPipeCapStyle.Dome, true);
      pipe.Add(pipe_ui);
    }

    for(int i = 0;i < Crvs_V.Count;i++)
    {
      var pipe_ui = Mesh.CreateFromCurvePipe(Crvs_V[i], r, 100, 50, MeshPipeCapStyle.Dome, true);
      pipe.Add(pipe_ui);
    }













    Pipes = pipe;
# ---------- end weave_pattern ----------
